% Simulink data dictionary VSM_Data_Dictionary.sldd

In_MainFilt_SpeedValue = Simulink.Signal(StorageClass="ImportedExtern", DataType="fixdt(0,8,1,0)", Min=1, Max=3, SampleTime=0.01)
In_AuxFilt_SpeedValue = Simulink.Signal(StorageClass="ImportedExtern", DataType="fixdt(0,8,1,0)", Min=1, Max=3, SampleTime=0.01)
Avg_VehicleSpeed = Simulink.Signal(StorageClass="ImportedExtern", DataType="fixdt(0,16,0.01,0)", Min=0, Max=280, SampleTime=0.01)
Timer_Input = Simulink.Signal(StorageClass="ImportedExtern", DataType="fixdt(0,16,0)", Min=0, Max=3000, SampleTime=0.01)
DisplaySpeed = Simulink.Signal(StorageClass="Localizable", DataType="fixdt(0,16,0.01,0)", Min=0, Max=250, SampleTime=0.01)
DisplaySpeed1 = Simulink.Signal(StorageClass="Localizable", DataType="fixdt(0,16,0.01,0)", Min=0, Max=250, SampleTime=0.01)
DisplaySpeed_Filter = Simulink.Signal(StorageClass="Localizable", DataType="fixdt(0,16,0.01,0)", Min=0, Max=250, SampleTime=0.01)
Out_VehicleSpeed_Display = Simulink.Signal(StorageClass="ExportedGlobal", DataType="fixdt(0,16,0.01,0)", Min=0, Max=250, SampleTime=0.01)