% Simulink design studies Vehicle_Speedometer_Module_harness_ds.mldatx for model Vehicle_Speedometer_Module_harness

study "Design Verifier Generated": 2 simulations
  combinatorial set (2 points):
    "Design Verifier Test Cases": BlockParameter(BlockPath=Testgeneration_harnessModel/Inputs, Name=ActiveScenario), values Label=TestCase_1, Label=TestCase_2 (2 points)